# Dynamo graph 2_helloWorld_createLoads.dyn (Dynamo 2.10.0.3455)
# packages: FemDesign 20.0.0

# group: scale
integer_slider = IntegerSlider(3, range=0..10 step 1)

# group: geometry
helloWorld = Custom[helloWorld](factor=integer_slider)

# group: material
default = FemDesign.Materials.MaterialDatabase.Default()
code_block = CodeBlock { "C45/55"; }
getMaterialByName = FemDesign.Materials.Material.GetMaterialByName(materialDatabase=default, materialName=code_block)

# group: plates
code_block_2 = CodeBlock { 0.2; }
plate = FemDesign.Shells.Slab.Plate(surface=helloWorld, thickness=code_block_2, material=getMaterialByName)

# group: load, loadcase, loadcombination
code_block_3 = CodeBlock { -1; }
byCoordinates = Vector.ByCoordinates(z=code_block_3)
code_block_4 = CodeBlock { "enhetsLast"; }
createLoadCase = FemDesign.Loads.LoadCase.CreateLoadCase(name=code_block_4)
uniform = FemDesign.Loads.SurfaceLoad.Uniform(surface=helloWorld, force=byCoordinates, loadCase=createLoadCase)
code_block_5 = CodeBlock { "LC1"; "ultimate_ordinary"; 100; }
createLoadCombination = FemDesign.Loads.LoadCombination.CreateLoadCombination(name=code_block_5.out0, type=code_block_5.out1, loadCase=createLoadCase, gamma=code_block_5.out2)

# group: supports
perimeterCurves = Surface.PerimeterCurves(surface=helloWorld)
hinged = FemDesign.Supports.LineSupport.Hinged(curve=perimeterCurves)
flatten = List.Flatten(list=hinged)

# group: model
createNewModel = FemDesign.Model.CreateNewModel(shells=plate, loads=uniform, loadCases=createLoadCase, loadCombinations=createLoadCombination, supports=flatten)

# group: open
file_path = Filename("..\..\..\..\..\..\..\temp\helloWorld.struxml")
code_block_6 = CodeBlock { true; }
openModel = FemDesign.Model.OpenModel(fdModel=createNewModel, struxmlPath=file_path, runNode=code_block_6)
