# Grasshopper definition myTruss.gh (Grasshopper 1.0.7)
# plug-ins: FEM-Design

info = Info(versionWhenCreated="23.2.0")
X = UnitX(Factor=1)
pt = Point(Point(0, 0, 0))
Z = UnitZ(Factor="3")
line = LineSDL(Start=pt, Direction=X, Length="12")
move = Move(Geometry=line, Motion=Z)  # -> Geometry, Transform
materialdatabase = MaterialDatabase(CountryCode="S")  # -> SteelMaterial, ConcreteMaterial, TimberMaterial, ReinforcementMaterial, StratumMaterial, CustomMaterial
sectiondatabase = SectionDatabase()  # -> SteelSection, ConcreteSection, TimberSection, HollowCoreSection, CustomSection
merge = Merge(Data1=line, Data2=move.Geometry)
divide = DivideCurve(Curve=merge, Count="5", Kinks=False)  # -> Points, Tangents, Parameters
flip = FlipMatrix(Data=divide.Points)
getmaterialbyname_index = MaterialGetMaterialByNameIndex(Materials=materialdatabase.SteelMaterial, MaterialNameIndex="S235J0")
getsectionbyname_index = SectionGetSectionByNameIndex(Sections=sectiondatabase.SteelSection, SectionNameIndex="5")
pline = PolyLine(Vertices=divide.Points, Closed=False)
pline_2 = PolyLine(Vertices=flip, Closed=False)
explode = Explode(Curve=pline, Recursive=True)  # -> Segments, Vertices
end = EndPoints(Curve=merge)  # -> Start, End
construct = LoadCaseConstruct(Name="VERTICAL LOAD", Type="Ordinary", DurationClass="permanent")
Z_2 = UnitZ(Factor="-10")
pointsupport = PointSupport(Plane=[end.Start, end.End], Tx=True, Ty=True, Tz=True, Rx=True, Ry=True, Rz=True, Identifier="S")
beam = BarsBeam(Curve=pline_2, Material=getmaterialbyname_index, Section=getsectionbyname_index, OrientLCS=True, Identifier="B")
beam_2 = BarsBeam(Curve=explode.Segments, Material=getmaterialbyname_index, Section=getsectionbyname_index, OrientLCS=True, Identifier="B")
pointload_define = PointLoadDefine(Point=divide.Points, Force=Z_2, LoadCase=construct, Type="Force")
construct_2 = LoadCombinationConstruct(Name="myCombo", Type="ultimate_ordinary", LoadCase=construct, Gamma="1.50")
create = LoadGroupCreate(
    Name="myGroup",
    Type=0,
    LoadCase=construct,
    StandardUnfavourableSafetyFactor="1.35",
    StandardFavourableSafetyFactor=1,
    AccidentalUnfavourableSafetyFactor=1,
    AccidentalFavourableSafetyFactor=1,
    LoadCaseRelationship=0,
    Xi="1.0",
    PotentiallyLeadingAction=1)
model_construct = ModelConstruct(
    CountryCode="S",
    StructureElements=flatten([beam, beam_2, pointsupport]),
    Loads=flatten(pointload_define),
    LoadCases=construct,
    LoadCombinations=construct_2,
    LoadGroups=create)
comb_define = CombDefine(
    NLEmaxiter=30,
    PLdefloadstep=20,
    PLminloadstep=2,
    PlKeepLoadStep=True,
    PlTolerance=1,
    Plmaxeqiter=50,
    PlShellLayers=10,
    NLSMohr=True,
    NLSinitloadstep=10,
    NLSminloadstep=10,
    NLSactiveelemratio=5,
    NLSplasticelemratio=5,
    CRloadstep=20,
    CRmaxiter=30,
    CRstifferror=2)
analysis_define = AnalysisDefine(
    Comb=comb_define,
    CalcCase=True,
    CalcComb=True,
    CalcCstage=False,
    CalcImpf=False,
    CalcGmax=False,
    CalcStab=False,
    CalcFreq=False,
    CalcSeis=False,
    CalcDesign=False,
    CalcFootfall=False,
    Elemfine=True,
    Diaphragm=0,
    PeakSmoothing=False)
fem_design_connection = FEMDesignConnection(Verbosity="ScriptLogLinesOnly", DeleteOutputFolder=False)
design_define = DesignDefine(Mode="steel", AutoDesign=False, Check=Toggle(True), BasedOn=True, ApplyChanges=Toggle(False))
fem_design_openmodel = FEMDesignOpenModel(Connection=fem_design_connection, Model=model_construct, RunNode=Toggle(False))  # -> Connection, Model, Success
python = GhPythonScript()  # -> a
# ---------- python: Python ----------
__author__ = "MarcoPellegrinoKonsu"
__version__ = "2022.07.25"

import rhinoscriptsyntax as rs
import os
a = os.path.join(rs.DocumentPath(), "myTruss.struxml")
# ---------- end python ----------
application_run = ApplicationRun(
    Model=model_construct,
    Analysis=analysis_define,
    Design=design_define,
    SaveFilePath=python,
    RunNode=Toggle(False),
    keepOpen=False,
    minimised=False)  # -> Model, FiniteElement, Results
