# Grasshopper definition Example 1b - Creating a simple slab.gh (Grasshopper 1.0.7)
# plug-ins: FEM-Design

default = MaterialDatabaseDefault(CountryCode="S")  # -> SteelMaterial, ConcreteMaterial, TimberMaterial, ReinforcementMaterial, StratumMaterial, CustomMaterial
panel = Panel(default.SteelMaterial)
getmaterialbyname_index = MaterialGetMaterialByNameIndex(Materials=default.SteelMaterial, MaterialNameIndex="S 355")
material = Data(getmaterialbyname_index)

rectangle = Rectangle(Plane=PlaneXY(0, 0, 0), XSize=Domain(-1, 1), YSize=Domain(-2, 2), Radius=0)  # -> Rectangle, Length
boundary = BoundarySurfaces(Edges=rectangle.Rectangle)

list = ValueList({"ordinary", "dead_load", "soil_dead_load", "shrinkage", "prestressing", "fire", "seis_sxp", "seis_sxm", "seis_syp", "seis_sym"}, selected="dead_load")
list_2 = ValueList({"ordinary", "dead_load", "soil_dead_load", "shrinkage", "prestressing", "fire", "seis_sxp", "seis_sxm", "seis_syp", "seis_sym"}, selected="ordinary")
list_3 = ValueList({"permanent", "long-term", "medium-term", "short-term", "instantaneous"}, selected="permanent")
list_4 = ValueList({"permanent", "long-term", "medium-term", "short-term", "instantaneous"}, selected="permanent")
construct = LoadCaseConstruct(Name="DeadLoad", Type=list, DurationClass=list_3)
construct_2 = LoadCaseConstruct(Name="LiveLoad", Type=list_2, DurationClass=list_4)

debrep = DeconstructBrep(Brep=boundary)  # -> Faces, Edges, Vertices
item = ListItem(List=debrep.Edges, Index="0", Wrap=True)
item_2 = ListItem(List=debrep.Edges, Index="2", Wrap=True)
end = EndPoints(Curve=item_2)  # -> Start, End
rigid = LineSupportRigid(Curve=item, MovingLocal=False, OrientLCS=True, Identifier="S")
rigid_2 = PointSupportRigid(PointPlane=[end.Start, end.End], Identifier="S")
support = Data([rigid, rigid_2])

loadcase = Data(construct)
loadcase_2 = Data(construct_2)
list_5 = ValueList({"ultimate_ordinary", "ultimate_accidental", "ultimate_seismic", "serviceability_quasi_permanent", "serviceability_frequent", "serviceability_characteristic"}, selected="ultimate_ordinary")
panel_2 = Panel("""1.35
1.50""")
merge = Merge(Data1=loadcase, Data2=loadcase_2)
construct_3 = LoadCombinationConstruct(Name="ULS", Type=list_5, LoadCase=merge, Gamma=panel_2)
loadcombination = Data(construct_3)

Z = UnitZ(Factor="-6.00")
srf = Surface(boundary)
loadcase_3 = Data(construct_2)
uniform = SurfaceLoadUniform(Surface=srf, Force=Z, LoadCase=loadcase_3)
load = Data(uniform)

srf_2 = Surface(boundary)
material_2 = Data(getmaterialbyname_index)
construct_4 = Plate(Surface=srf_2, Thickness="0.25", Material=material_2, Identifier="P")
slab = Data(construct_4)

loadcase_4 = Data([construct, construct_2])

loadcombinations = Data(flatten(loadcombination))
loadcases = Data(flatten(loadcase_4))
elements = Data(flatten([slab, support]))
loads = Data(flatten(load))
construct_5 = ModelConstruct(CountryCode="S", StructureElements=elements, Loads=loads, LoadCases=loadcases, LoadCombinations=loadcombinations)
model = Data(construct_5)

connection = FEMDesignConnection(DeleteOutputFolder=False)
define = CombDefine(
    NLEmaxiter=30,
    PLdefloadstep=20,
    PLminloadstep=2,
    Plmaxeqiter=30,
    NLSMohr=True,
    NLSinitloadstep=10,
    NLSminloadstep=10,
    NLSactiveelemratio=5,
    NLSplasticelemratio=5,
    CRloadstep=20,
    CRmaxiter=30,
    CRstifferror=2)
model_2 = Data(model)
toggle = BooleanToggle(True)
analysis = AnalysisDefine(
    Comb=define,
    CalcCase=toggle,
    CalcCstage=False,
    CalcImpf=False,
    CalcComb=toggle,
    CalcGmax=False,
    CalcStab=False,
    CalcFreq=False,
    CalcSeis=False,
    CalcDesign=False,
    CalcFootfall=False,
    Elemfine=False,
    Diaphragm=False,
    PeakSmoothing=False)
openmodel = FEMDesignOpenModel(Connection=connection, Model=model_2, RunNode=True)  # -> Connection, Model, Success
resultstype = ResultsType({"NodalDisplacement", "PointSupportReaction", "PointSupportReactionMinMax", "BarDisplacement", "BarInternalForce", "BarStress", "LineSupportReaction", "ShellDisplacement", "ShellInternalForce", "ShellStress", "LabelledSectionInternalForce", "LabelledSectionResultant", "NodalVibrationShape", "EigenFrequencies", "QuantityEstimationConcrete", "QuantityEstimationSteel", "QuantityEstimationTimber", "QuantityEstimationTimberPanel", "QuantityEstimationGeneral", "QuantityEstimationReinforcement"}, selected="PointSupportReaction")
runanalysis = FEMDesignRunAnalysis(Connection=openmodel.Connection, Analysis=analysis, RunNode=True)  # -> Connection, Log, Success
getcasecombresults = FEMDesignGetCaseCombResults(Connection=runanalysis.Connection, ResultType=resultstype, RunNode=True)  # -> Connection, Results, Success
results = Data(getcasecombresults.Results)

results_2 = Data(results)
pointsupportreaction = PointSupportReaction(Result=results_2, CaseCombinationName="LiveLoad")  # -> CaseIdentifier, Identifier, NodeId, SupportPosition, ReactionForce, ReactionMoment, ForceResultant, MomentResultant
panel_3 = Panel(pointsupportreaction.SupportPosition)
panel_4 = Panel(pointsupportreaction.ReactionForce)
