# Grasshopper definition Example 9 - ReadResults.gh (Grasshopper 1.0.7)
# plug-ins: FEM-Design

resultstype = ResultsType({"NodalDisplacement", "PointSupportReaction", "PointSupportReactionMinMax", "PointConnectionForce", "BarDisplacement", "BarInternalForce", "BarStress", "LineSupportReaction", "LineConnectionResultant", "LineConnectionForce", "SurfaceSupportReaction", "ShellDisplacement", "ShellInternalForce", "ShellStress", "CLTShellUtilization", "CLTFireUtilization", "LabelledSectionInternalForce", "LabelledSectionResultant", "NodalVibrationShape", "EigenFrequencies", "CriticalParameter", "ImperfectionFactor", "QuantityEstimationConcrete", "QuantityEstimationSteel", "QuantityEstimationTimber", "QuantityEstimationTimberPanel", "QuantityEstimationGeneral", "QuantityEstimationReinforcement", "FiniteElement"}, selected="FiniteElement")

# ----
# Use 'ResultsType' value list component
# to select the result to be returned.
# NOTE
# The results can be extracted if the model has been analysed.
# FEM-design will generate an ".strFEM" file from which we will read the results.
python = GhPythonScript()  # -> out, folder
# ---------- python: Python ----------
__author__ = "MarcoPellegrinoKonsu"
__version__ = "2022.06.30"

import rhinoscriptsyntax as rs

folder = rs.DocumentPath()
# ---------- end python ----------
str_file = Panel("myModel.str")
resultstype_2 = ResultsType({"NodalDisplacement", "PointSupportReaction", "PointSupportReactionMinMax", "PointConnectionForce", "BarDisplacement", "BarInternalForce", "BarStress", "LineSupportReaction", "LineConnectionResultant", "LineConnectionForce", "SurfaceSupportReaction", "ShellDisplacement", "ShellInternalForce", "ShellStress", "CLTShellUtilization", "CLTFireUtilization", "LabelledSectionInternalForce", "LabelledSectionResultant", "NodalVibrationShape", "EigenFrequencies", "CriticalParameter", "ImperfectionFactor", "QuantityEstimationConcrete", "QuantityEstimationSteel", "QuantityEstimationTimber", "QuantityEstimationTimberPanel", "QuantityEstimationGeneral", "QuantityEstimationReinforcement", "FiniteElement"}, selected="NodalDisplacement")
concat = Concatenate(FragmentA=python.folder, FragmentB=str_file)
path = FilePath(concat)
readresults = ModelReadResults(StrPath=path, ResultTypes=resultstype, RunNode=True)
readresults_2 = ModelReadResults(StrPath=path, ResultTypes=resultstype_2, RunNode=True)
nodaldisplacement = NodalDisplacement(Result=readresults_2, CaseCombinationName="SELF WEIGHT")  # -> CaseIdentifier, NodeId, Translation, Rotation

# ---- group: Finite Element from FEMDesign
data = Data(readresults)
femshell = FiniteElementFemShell(FiniteElement=data)  # -> Identifier, ElementId, FaceIndex, MeshGeometry
fembar = FiniteElementFemBar(FiniteElement=data)  # -> Identifier, ElementId, NodeI, NodeJ, LineGeometry
femnode = FiniteElementFemNode(FiniteElement=data)  # -> NodeId, Point

# ----
int = Integer(femnode.NodeId)
geo = Geometry(femnode.Point)
geo_2 = Geometry(fembar.LineGeometry)
geo_3 = Geometry(femshell.MeshGeometry)

int_2 = Integer(nodaldisplacement.NodeId)
multiplication = Multiplication(A=nodaldisplacement.Translation, B=Slider(100, range=0..100))
keysearch = KeyValueSearch(Keys=int, Values=geo, Search=int_2)
move = Move(Geometry=keysearch, Motion=multiplication)  # -> Geometry, Transform

resultstype_3 = ResultsType({"NodalDisplacement", "PointSupportReaction", "PointSupportReactionMinMax", "PointConnectionForce", "BarDisplacement", "BarInternalForce", "BarStress", "LineSupportReaction", "LineConnectionResultant", "LineConnectionForce", "SurfaceSupportReaction", "ShellDisplacement", "ShellInternalForce", "ShellStress", "CLTShellUtilization", "CLTFireUtilization", "LabelledSectionInternalForce", "LabelledSectionResultant", "NodalVibrationShape", "EigenFrequencies", "CriticalParameter", "ImperfectionFactor", "QuantityEstimationConcrete", "QuantityEstimationSteel", "QuantityEstimationTimber", "QuantityEstimationTimberPanel", "QuantityEstimationGeneral", "QuantityEstimationReinforcement", "FiniteElement"}, selected=["NodalDisplacement", "PointSupportReaction"])
# Selecting more than one ResultType will generate a
# DataTree structure in the 'Results' output.
# You can use 'BANG' or 'Branch' to select the desire result.
python_2 = GhPythonScript()  # -> out, folder; same code as python
concat_2 = Concatenate(FragmentA=python_2.folder, FragmentB="myModel.str")
path_2 = FilePath(concat_2)

readresults_3 = ModelReadResults(StrPath=path_2, ResultTypes=resultstype_3, RunNode=True)

bang = ExplodeTree(Data=readresults_3)  # -> Branch0, Branch1
panel = Panel(bang.Branch1)
nodaldisplacement_2 = NodalDisplacement(Result=bang.Branch0, CaseCombinationName="SELF WEIGHT")  # -> CaseIdentifier, NodeId, Translation, Rotation
branch = TreeBranch(Tree=readresults_3, Path="1", MaintainPaths=True)
pointsupportreaction = PointSupportReaction(Result=branch, CaseCombinationName="self weight")  # -> CaseIdentifier, Identifier, NodeId, SupportPosition, ReactionForce, ReactionMoment, ForceResultant, MomentResultant

pointsupportreaction_2 = PointSupportReaction(Result=bang.Branch1, CaseCombinationName="self weight")  # -> CaseIdentifier, Identifier, NodeId, SupportPosition, ReactionForce, ReactionMoment, ForceResultant, MomentResultant
