# Grasshopper definition intSurface_OnBars.gh (Grasshopper 1.0.7)
# plug-ins: FEM-Design, BH.UI.Grasshopper

curve = Curve(<curve referenced from the Rhino model>)
unit_x = UnitX(Factor=1)
point = Point(Point(0, 0, 0))
line_sdl = LineSDL(Start=point, Direction=unit_x, Length="5")
offset_curve = OffsetCurve(Curve=curve, Distance="-0.02", Corners=1)
section_define = SectionDefine(Surfaces=curve, MaterialType="Concrete", GroupName="T-Section", TypeName="T-Section", SizeName="T-Section")
path = FilePath("C:\Users\Marco\OneDrive - StruSoft AB\FD API\Resources\materialLibrary\materials_S.struxml")
cluster = Cluster()  # -> material, section
curve_2 = Curve(offset_curve)
fromstruxml = MaterialDatabaseFromStruxml(FilePath=path)  # -> SteelMaterial, ConcreteMaterial, TimberMaterial, ReinforcementMaterial, StratumMaterial, CustomMaterial
offset_curve_2 = OffsetCurve(Curve=curve_2, Distance="-0.015", Corners=1)
item = ListItem(List=fromstruxml.ReinforcementMaterial, Index=0, Wrap=True)
wire_define = WireDefine(Diameter="0.01", Material=item, Profile="ribbed")
curve_3 = Curve(offset_curve)
bars_beam = BarsBeam(Curve=line_sdl, Material=cluster.material, Section=section_define, OrientLCS=True, Identifier="B")
wire_define_2 = WireDefine(Diameter="0.006", Material=item, Profile="ribbed")
barreinforcement_stirrups = BarReinforcementStirrups(Wire=wire_define, Profile=curve_3, Start="0", End="5", Spacing="0.1")
explode = Explode(Component="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")
duplicate_data = DuplicateData(Number=2, Order=True)
divide_curve = DivideCurve(Curve=offset_curve_2, Count="60", Kinks=False)  # -> Points, Tangents, Parameters
deconstruct = Deconstruct(Point=divide_curve.Points)  # -> XComponent, YComponent, ZComponent
barreinforcement_longitudinalbar = BarReinforcementLongitudinalBar(
    Wire=wire_define_2,
    YPos=deconstruct.XComponent,
    ZPos=deconstruct.YComponent,
    StartAnchorage="0.40",
    EndAnchorage="0.40",
    Start="0",
    End="5",
    AuxiliaryBar=False)
bars_deconstruct_modify = BarsDeconstructModify(
    Bar=bars_beam,
    NewGuid=Toggle(True),
    Stirrups=barreinforcement_stirrups,
    LongitudinalBars=barreinforcement_longitudinalbar)  # -> flatten(Bar), Guid, Curve, Material, Section, Connectivity, Eccentricity, LocalY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
interactionsurface_onbar = InteractionSurfaceOnBar(Bar=bars_deconstruct_modify.Bar, FUlt=True, Offset="4.0")  # -> InteractionSurface, N, My, Mz
panel = Panel(interactionsurface_onbar.InteractionSurface)

# ==== cluster Cluster
path = FilePath("C:\Users\Marco\OneDrive - StruSoft AB\FD API\Resources\materialLibrary\materials_S.struxml")
path_2 = FilePath("C:\Users\Marco\OneDrive - StruSoft AB\FD API\Resources\sectionLibrary\sections.struxml")
fromstruxml = MaterialDatabaseFromStruxml(FilePath=path)  # -> SteelMaterial, ConcreteMaterial, TimberMaterial, ReinforcementMaterial, StratumMaterial, CustomMaterial
fromstruxml_2 = SectionDatabaseFromStruxml(FilePath=path_2)  # -> SteelSection, ConcreteSection, TimberSection, HollowCoreSection, CustomSection
item = ListItem(List=fromstruxml_2.ConcreteSection, Index="84", Wrap=True)
item_2 = ListItem(List=fromstruxml.ConcreteMaterial, Index=0, Wrap=True)
section = ClusterOutput(item)
material = ClusterOutput(item_2)
