# Grasshopper definition Practical example - Modelling and analysing a bridge.gh (Grasshopper 1.0.7)
# plug-ins: FEM-Design

# ----
# Variables
width_driving_lane = Slider(7, range=1..50)
width_extra_edge = Slider(5, range=1..50)
axis_crossection_base_point = Point(Point(0, 0, 0))
height = Slider(3, range=1..50)
width_base = Slider(5, range=1..50)
width_support_points = Slider(5, range=1..50)
height_y_support = Slider(5, range=1..50)

# ----
# Method 3: Doubly curved axis (Start/end points, start/end tangents,
# and straight distance between ends)
start_tangent_x = Slider(-9, range=-20..20)
start_tangent_y = Slider(15, range=-20..20)
bridge_length = Slider(100, range=1..500)
end_tangent_x = Slider(-4, range=-20..20)
start_tangent_z = Slider(8, range=-20..20)
end_tangent_y = Slider(15, range=-20..20)
end_tangent_z = Slider(3, range=-20..20)
vector_xyz = VectorXYZ(XComponent=start_tangent_x, YComponent=start_tangent_y, ZComponent=start_tangent_z)  # -> Vector, Length
vector_xyz_2 = VectorXYZ(XComponent=end_tangent_x, YComponent=end_tangent_y, ZComponent=end_tangent_z)  # -> Vector, Length
axis_crossection_base_point_2 = Point(axis_crossection_base_point)
unit_y = UnitY(Factor=bridge_length)
move = Move(Geometry=axis_crossection_base_point_2, Motion=unit_y)  # -> Geometry, Transform
biarc = BiArc(
    StartPoint=axis_crossection_base_point_2,
    StartTangent=vector_xyz.Vector,
    EndPoint=move.Geometry,
    EndTangent=vector_xyz_2.Vector,
    Ratio=0.5)  # -> FirstArc, SecondArc, BiArc
curve_middle = CurveMiddle(Curve=biarc.FirstArc)
deconstruct = Deconstruct(Point=curve_middle)  # -> XComponent, YComponent, ZComponent
get_data_from_me = Curve(biarc.BiArc)
rise_m = Panel(deconstruct.ZComponent)

# ----
# 2. Creating the axis of the bridge
# The second part of the bridge is the axis. In this script, you can test out three
# simple methods for generating an arbitrary axis, each with their own variables.
# Method 1: straight line axis (start and end)
bridge_length_2 = Slider(100, range=1..500)
axis_crossection_base_point_3 = Point(axis_crossection_base_point)
unit_y_2 = UnitY(Factor=bridge_length_2)
move_2 = Move(Geometry=axis_crossection_base_point_3, Motion=unit_y_2)  # -> Geometry, Transform
line = Line(StartPoint=axis_crossection_base_point_3, EndPoint=move_2.Geometry)

# ----
# Method 2: arch axis (start, end and midpoint height)
number_slider = Slider(10, range=0..20)
bridge_length_3 = Slider(100, range=1..500)
axis_crossection_base_point_4 = Point(axis_crossection_base_point)
unit_y_3 = UnitY(Factor=bridge_length_3)
vector_xyz_3 = VectorXYZ(XComponent=0, YComponent=expr("x/2", bridge_length_3), ZComponent=number_slider)  # -> Vector, Length
move_3 = Move(Geometry=axis_crossection_base_point_4, Motion=vector_xyz_3.Vector)  # -> Geometry, Transform
move_4 = Move(Geometry=axis_crossection_base_point_4, Motion=unit_y_3)  # -> Geometry, Transform
merge = Merge(Data1=axis_crossection_base_point_4, Data2=move_3.Geometry, Data3=move_4.Geometry)
nurbs_curve = NurbsCurve(Vertices=merge, Degree="2", Periodic=False)  # -> Curve, Length, Domain

# ----
# Ground surface
# For the pillars to connect to.
ground_surface = Surface(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)
preview = CustomPreview(Geometry=ground_surface, Material=ColourSwatch(SwatchColor=RGBA(0, 212, 255, 70)))

# ----
# 1. Creating the crossection
# The first part of the bridge is the crossection. In this script, you can vary
# the width of the driving lane, the extra edge, the height and the width
# of the lower flange. You can also vary the shape of the Y supports.
unit_z = UnitZ(Factor=expr("-x", height))
unit_x = UnitX(Factor=width_driving_lane)
move_5 = Move(Geometry=axis_crossection_base_point, Motion=unit_x)  # -> Geometry, Transform
unit_x_2 = UnitX(Factor=width_extra_edge)
move_6 = Move(Geometry=axis_crossection_base_point, Motion=unit_z)  # -> Geometry, Transform
unit_x_3 = UnitX(Factor=width_base)
move_7 = Move(Geometry=move_5.Geometry, Motion=unit_x_2)  # -> Geometry, Transform
move_8 = Move(Geometry=move_6.Geometry, Motion=unit_x_3)  # -> Geometry, Transform
line_2 = Line(StartPoint=move_7.Geometry, EndPoint=move_5.Geometry)
line_3 = Line(StartPoint=move_5.Geometry, EndPoint=axis_crossection_base_point)
line_4 = Line(StartPoint=move_5.Geometry, EndPoint=move_8.Geometry)
line_5 = Line(StartPoint=move_8.Geometry, EndPoint=move_6.Geometry)

# ----
# Geometry
unit_x_4 = UnitX(Factor=width_support_points)
neg = Negative(Value=height_y_support)
Z = UnitZ(Factor=neg)
move_9 = Move(Geometry=move_6.Geometry, Motion=unit_x_4)  # -> Geometry, Transform
mirror = Mirror(Geometry=move_9.Geometry, Plane=PlaneYZ(0, 0, 0))  # -> Geometry, Transform
merge_2 = Merge(Data1=move_9.Geometry, Data2=mirror.Geometry)
mirror_2 = Mirror(Geometry=line_4, Plane=PlaneYZ(0, 0, 0))  # -> Geometry, Transform
mirror_3 = Mirror(Geometry=line_5, Plane=PlaneYZ(0, 0, 0))  # -> Geometry, Transform
mirror_4 = Mirror(Geometry=line_3, Plane=PlaneYZ(0, 0, 0))  # -> Geometry, Transform
mirror_5 = Mirror(Geometry=line_2, Plane=PlaneYZ(0, 0, 0))  # -> Geometry, Transform
merge_3 = Merge(Data1=line_2, Data2=mirror_5.Geometry)
merge_4 = Merge(Data1=line_4, Data2=mirror_2.Geometry)
merge_5 = Merge(Data1=line_5, Data2=mirror_3.Geometry)
merge_6 = Merge(Data1=line_3, Data2=mirror_4.Geometry)
inner_road_lines = Line(merge_6)
outer_road_lines = Line(merge_3)
crosssection_side_lines = Line(merge_4)
crosssection_base_lines = Line(merge_5)

# ----
# Select your method by
# connecting to this container
bridge_axis_select_your_axis_method = Curve(get_data_from_me)

# ----
# Example: modelling a bridge
# This example show how you can create a simple parametric model of a bridge.
# The main idea is being able to customize the crossection and shape of the bridge
# with simple inputs, and having the resulting model built automatically.
info = Info(versionWhenCreated="23.2.0")

# ---- group: Warning: lower values means heavier calculations!
triangulation_length_avg = Slider(3.33, range=0.5..10)

# ----
# Method 2: Explicit length from bridge start
panel = Panel("""0
10
25""")
bridge_axis = Curve(reparameterize(bridge_axis_select_your_axis_method))
length = Length(Curve=bridge_axis)
remap_numbers = RemapNumbers(Value=panel, Source=length, Target=Domain(0, 1))  # -> Mapped, Clipped
evaluate_curve = EvaluateCurve(Curve=reparameterize(bridge_axis), Parameter=remap_numbers.Mapped)  # -> Point, Tangent, Angle

# ----
# Method 1: relative length along bridge axis
panel_2 = Panel("""0.2
0.5
0.8""")
# 5a. Creating pillar supports
# This example showcases two ways to place your support along the axis. After that, the script finds
# a compromise between these positions and suitable points in the triangulation above, to make sure that
# the supports are properly connected to the mesh when the FEM-Design model is generated.
bridge_axis_2 = Curve(bridge_axis_select_your_axis_method)
evaluate_curve_2 = EvaluateCurve(Curve=reparameterize(bridge_axis_2), Parameter=panel_2)  # -> Point, Tangent, Angle

# ----
# Relative length along bridge axis
panel_3 = Panel("""0.02
0.98""")
# 5b. Creating point supports
# The supports at the start and end of a bridge are rarely pillars, so different support conditions are needed.
# These three blocks generate these supports, using the relative-length method.
bridge_axis_3 = Curve(bridge_axis_select_your_axis_method)
evaluate_curve_3 = EvaluateCurve(Curve=reparameterize(bridge_axis_3), Parameter=panel_3)  # -> Point, Tangent, Angle

# ----
# Select your method by
# connecting to this container
points_on_curve_pick_your_point_method = Point(evaluate_curve_2.Point)

# ----
# Defining load cases
panel_4 = Panel("Liveload")
list = ValueList({"ordinary", "dead_load", "soil_dead_load", "shrinkage", "prestressing", "fire", "seis_sxp", "seis_sxm", "seis_syp", "seis_sym"}, selected="dead_load")
list_2 = ValueList({"ordinary", "dead_load", "soil_dead_load", "shrinkage", "prestressing", "fire", "seis_sxp", "seis_sxm", "seis_syp", "seis_sym"}, selected="ordinary")
list_3 = ValueList({"permanent", "long-term", "medium-term", "short-term", "instantaneous"}, selected="permanent")
list_4 = ValueList({"permanent", "long-term", "medium-term", "short-term", "instantaneous"}, selected="permanent")
construct = LoadCaseConstruct(Name="Deadload", Type=list, DurationClass=list_3)
construct_2 = LoadCaseConstruct(Name=panel_4, Type=list_2, DurationClass=list_4)
merge_7 = Merge(Data1=construct, Data2=construct_2)

# ----
# Sections and Material databases
panel_5 = Panel("S")
materialdatabase = MaterialDatabase(CountryCode=panel_5)  # -> SteelMaterial, ConcreteMaterial, TimberMaterial, ReinforcementMaterial, StratumMaterial, CustomMaterial
sectiondatabase = SectionDatabase()  # -> SteelSection, ConcreteSection, TimberSection, HollowCoreSection, CustomSection

hinged = ConnectivityHinged()
rigid = ConnectivityRigid()

# ----
# Defining load combinations
list_5 = ValueList({"ultimate_ordinary", "ultimate_accidental", "ultimate_seismic", "serviceability_quasi_permanent", "serviceability_frequent", "serviceability_characteristic"}, selected="serviceability_characteristic")
list_6 = ValueList({"ultimate_ordinary", "ultimate_accidental", "ultimate_seismic", "serviceability_quasi_permanent", "serviceability_frequent", "serviceability_characteristic"}, selected="ultimate_ordinary")
panel_6 = Panel("""1.0
1.0""")
panel_7 = Panel("""1.35
1.5""")
construct_3 = LoadCombinationConstruct(Name="SLS", Type=list_5, LoadCase=merge_7, Gamma=panel_6)
construct_4 = LoadCombinationConstruct(Name="ULS", Type=list_6, LoadCase=merge_7, Gamma=panel_7)
merge_8 = Merge(Data1=construct_3, Data2=construct_4)

merge_9 = Merge(Data1=hinged, Data2=rigid)

# ----
# Top flange
merge_10 = Merge(Data1=outer_road_lines, Data2=inner_road_lines)
axis_crossection_base_point_5 = Point(axis_crossection_base_point)
crossection = Curve(merge_10)
bridge_axis_4 = Curve(bridge_axis_select_your_axis_method)
length_2 = Length(Curve=bridge_axis_4)
division = Division(A=length_2, B=triangulation_length_avg)
round = Round(Number=division)  # -> Nearest, Floor, Ceiling
length_3 = Length(Curve=crossection)
divide_curve = DivideCurve(Curve=bridge_axis_4, Count=round.Floor, Kinks=False)  # -> graft(Points), graft(Tangents), Parameters
number_of_segments_lenghwise = Panel(round.Floor)
division_2 = Division(A=length_3, B=triangulation_length_avg)
Z_2 = UnitZ(Factor=1)
round_2 = Round(Number=division_2)  # -> Nearest, Floor, Ceiling
vector_display = VectorDisplay(Anchor=divide_curve.Points, Vector=divide_curve.Tangents)
xprod = CrossProduct(VectorA=divide_curve.Tangents, VectorB=Z_2, Unitize=False)  # -> Vector, Length
number_of_segments_across = Panel(round_2.Floor)
pylon_support_points = Point(merge_2)
toggle = BooleanToggle(False)
toggle_2 = BooleanToggle(False)

# ----
# Web and bottom flange
merge_11 = Merge(Data1=crosssection_side_lines, Data2=crosssection_base_lines)
axis_crossection_base_point_6 = Point(axis_crossection_base_point)
crossection_2 = Curve(merge_11)
bridge_axis_5 = Curve(bridge_axis_select_your_axis_method)
length_4 = Length(Curve=bridge_axis_5)
division_3 = Division(A=length_4, B=triangulation_length_avg)
round_3 = Round(Number=division_3)  # -> Nearest, Floor, Ceiling
length_5 = Length(Curve=crossection_2)
divide_curve_2 = DivideCurve(Curve=bridge_axis_5, Count=round_3.Floor, Kinks=False)  # -> graft(Points), graft(Tangents), Parameters
number_of_segments_lenghwise_2 = Panel(round_3.Floor)
division_4 = Division(A=length_5, B=triangulation_length_avg)
Z_3 = UnitZ(Factor=1)
round_4 = Round(Number=division_4)  # -> Nearest, Floor, Ceiling
vector_display_2 = VectorDisplay(Anchor=divide_curve_2.Points, Vector=divide_curve_2.Tangents)
xprod_2 = CrossProduct(VectorA=divide_curve_2.Tangents, VectorB=Z_3, Unitize=False)  # -> Vector, Length
toggle_3 = BooleanToggle(False)
toggle_4 = BooleanToggle(False)

# ----
# 3. Creating a rough bridge volume, and triangulating it
# By copying the crossection along the axis, we outline the basic shape of the bridge. Using predetermined points on each crossection
# we can evenly triangulate the entire surface of the bridge, making sure that FEM-Design can mesh the model properly. The top flange
# is generated separately, to avoid having to sort out data when applying the loads.
number_of_segments_across_2 = Panel(round_4.Floor)
pl = ConstructPlane(Origin=divide_curve.Points, XAxis=xprod.Vector, YAxis=Z_2)
xz = XZPlane(Origin=axis_crossection_base_point_5)
pl_2 = ConstructPlane(Origin=divide_curve_2.Points, XAxis=xprod_2.Vector, YAxis=Z_3)
xz_2 = XZPlane(Origin=axis_crossection_base_point_6)
pylon_support_points_2 = Point(merge_2)

orient = Orient(Geometry=crossection, Source=xz, Target=pl)  # -> Geometry, Transform
orient_2 = Orient(Geometry=pylon_support_points, Source=xz, Target=pl)  # -> Geometry, Transform
divide_curve_3 = DivideCurve(Curve=orient.Geometry, Count=round_2.Floor, Kinks=False)  # -> Points, Tangents, Parameters
loft = Loft(Curves=orient.Geometry, Options={Adjust=False, Closed=False, LoftEnds=0, LoftSimp=0, LoftType=3, Rebuild=10, Refit=0.01})
shift_list = ShiftList(List=divide_curve_3.Points, Shift="1", Wrap=toggle)
shift_list_2 = ShiftList(List=divide_curve_3.Points, Shift="-1", Wrap=toggle)
pshift = ShiftPaths(Data=shift_list, Offset=-1)
pshift_2 = ShiftPaths(Data=shift_list_2, Offset=-1)
relative_item = RelativeItem(Tree=pshift, Offset="{0;0;-1;0}", WrapPaths=toggle_2, WrapItems=toggle)  # -> ItemA, ItemB
relative_item_2 = RelativeItem(Tree=pshift_2, Offset="{0;0;+1;0}", WrapPaths=toggle_2, WrapItems=toggle)  # -> ItemA, ItemB
_4point_surface = _4PointSurface(CornerA=relative_item.ItemB, CornerB=relative_item_2.ItemA, CornerC=relative_item_2.ItemB)
_4point_surface_2 = _4PointSurface(CornerA=relative_item.ItemA, CornerB=relative_item.ItemB, CornerC=relative_item_2.ItemB)
pshift_3 = ShiftPaths(Data=_4point_surface, Offset=-1)
pshift_4 = ShiftPaths(Data=_4point_surface_2, Offset=-1)
merge_12 = Merge(Data1=pshift_4, Data2=pshift_3)

orient_3 = Orient(Geometry=crossection_2, Source=xz_2, Target=pl_2)  # -> Geometry, Transform
orient_4 = Orient(Geometry=pylon_support_points_2, Source=xz_2, Target=pl_2)  # -> Geometry, Transform
divide_curve_4 = DivideCurve(Curve=orient_3.Geometry, Count=round_4.Floor, Kinks=False)  # -> Points, Tangents, Parameters
shift_list_3 = ShiftList(List=divide_curve_4.Points, Shift="1", Wrap=toggle_3)
shift_list_4 = ShiftList(List=divide_curve_4.Points, Shift="-1", Wrap=toggle_3)
pshift_5 = ShiftPaths(Data=shift_list_3, Offset=-1)
pshift_6 = ShiftPaths(Data=shift_list_4, Offset=-1)
relative_item_3 = RelativeItem(Tree=pshift_5, Offset="{0;0;-1;0}", WrapPaths=toggle_4, WrapItems=toggle_3)  # -> ItemA, ItemB
relative_item_4 = RelativeItem(Tree=pshift_6, Offset="{0;0;+1;0}", WrapPaths=toggle_4, WrapItems=toggle_3)  # -> ItemA, ItemB
_4point_surface_3 = _4PointSurface(CornerA=relative_item_3.ItemB, CornerB=relative_item_4.ItemA, CornerC=relative_item_4.ItemB)
_4point_surface_4 = _4PointSurface(CornerA=relative_item_3.ItemA, CornerB=relative_item_3.ItemB, CornerC=relative_item_4.ItemB)
pshift_7 = ShiftPaths(Data=_4point_surface_3, Offset=-1)
pshift_8 = ShiftPaths(Data=_4point_surface_4, Offset=-1)
merge_13 = Merge(Data1=pshift_8, Data2=pshift_7)

# ----
# Find suitable support reference points
move_10 = Move(Geometry=points_on_curve_pick_your_point_method, Motion=unit_z)  # -> Geometry, Transform
cps = ClosestPoints(Point=graft(move_10.Geometry), Cloud=flatten(orient_4.Geometry), Count=2)  # -> ClosestPoint, CPIndex, Distance
pylon_support_points_3 = Point(cps.ClosestPoint)

# ----
# Find suitable support reference points
move_11 = Move(Geometry=evaluate_curve_3.Point, Motion=unit_z)  # -> Geometry, Transform
cps_2 = ClosestPoints(Point=graft(move_11.Geometry), Cloud=flatten(orient_4.Geometry), Count=2)  # -> ClosestPoint, CPIndex, Distance
support_points = Point(cps_2.ClosestPoint)

# ----
# For visualisation only -
# no output from here!
loft_2 = Loft(
    Curves=orient_3.Geometry,
    Options={Adjust=False, Closed=False, LoftEnds=0, LoftSimp=0, LoftType=3, Rebuild=10, Refit=0.01})

panel_8 = Panel(move_10.Geometry)

# ----
# Support conditions
panel_9 = Panel("10^9")
rotations_define = RotationsDefine(X_neg="0", X_pos="0", Y_neg="0", Y_pos="0", Z_neg="0", Z_pos="0")
motions_define = MotionsDefine(X_neg=panel_9, X_pos=panel_9, Y_neg=panel_9, Y_pos=panel_9, Z_neg=panel_9, Z_pos=panel_9)
pointsupport_define = PointSupportDefine(Point=support_points, Motions=motions_define, Rotations=rotations_define, Identifier="S")

# ----
# Model support pillars
avr = Average(Input=pylon_support_points_3)
item = ListItem(List=pylon_support_points_3, Index=0, Wrap=False)  # -> Item, Item1
move_12 = Move(Geometry=avr, Motion=Z)  # -> Geometry, Transform
Z_4 = UnitZ(Factor=-1)
ln = Line(StartPoint=item.Item, EndPoint=move_12.Geometry)
ln_2 = Line(StartPoint=item.Item1, EndPoint=move_12.Geometry)
ground_surface_2 = Surface(ground_surface)
project = ProjectPoint(Point=move_12.Geometry, Direction=Z_4, Geometry=ground_surface_2)  # -> Point, Index
merge_14 = Merge(Data1=ln, Data2=ln_2)
ln_3 = Line(StartPoint=move_12.Geometry, EndPoint=project.Point)
pylon_arms = Curve(merge_14)
pylon_base = Curve(ln_3)

panel_10 = Panel(project.Point)

# ----
# 4. Constructing bridge surface elements
# Before sending the elements off to the final model, you can add a component to define the size
# of the mesh in FEM-design. Please note that this is not the same as the triangulation done earlier!
merge_15 = Merge(Data1=merge_12, Data2=merge_13)
getmaterialbyname_index = MaterialGetMaterialByNameIndex(Materials=materialdatabase.ConcreteMaterial, MaterialNameIndex="C30/37")
fem_design_mesh_size = Slider(0.5, range=0..1)
construct_5 = Plate(Surface=merge_15, Thickness=Slider(0.5, range=0.1..1), Material=getmaterialbyname_index, Identifier="P")
slab_averagesurfaceelementsize = SlabAverageSurfaceElementSize(Slab=construct_5, AverageSurfaceElementSize=fem_design_mesh_size)

# ----
# Support conditions
panel_11 = Panel("10^7")
rotations_define_2 = RotationsDefine(X_neg="10^7", X_pos="10^7", Y_neg="10^7", Y_pos="10^7", Z_neg="10^7", Z_pos="10^7")
motions_define_2 = MotionsDefine(X_neg=panel_11, X_pos=panel_11, Y_neg=panel_11, Y_pos=panel_11, Z_neg=panel_11, Z_pos=panel_11)
pointsupport_define_2 = PointSupportDefine(Point=project.Point, Motions=motions_define_2, Rotations=rotations_define_2, Identifier="S")

# ----
# Constructing support elements
panel_12 = Panel("Concrete sections, Circle, D 1200")

getmaterialbyname_index_2 = MaterialGetMaterialByNameIndex(Materials=materialdatabase.ConcreteMaterial, MaterialNameIndex="C25/30")
getsectionbyname_index = SectionGetSectionByNameIndex(
    Sections=sectiondatabase.ConcreteSection,
    SectionNameIndex=["Concrete sections, Circle, D 1200", "Concrete sections, Circle, D 500"])
getsectionbyname_index_2 = SectionGetSectionByNameIndex(Sections=sectiondatabase.ConcreteSection, SectionNameIndex=panel_12)
beam = BarsBeam(
    Curve=pylon_arms,
    Material=getmaterialbyname_index_2,
    Section=getsectionbyname_index,
    Connectivity=merge_9,
    OrientLCS=True,
    Identifier="B")
beam_2 = BarsBeam(Curve=pylon_base, Material=getmaterialbyname_index_2, Section=getsectionbyname_index_2, OrientLCS=True, Identifier="B")

merge_16 = Merge(Data1=beam, Data2=beam_2)

# ----
# 6. Creating loads
# Defining loads
# The loads in this example are simple surface loads, but applying more
# complicated loads and load combinations is also possible.
# All loads are applied to the top flange.
top_flange = Surface(simplify(merge_12))
unit_z_2 = UnitZ(Factor=expr("-x", Slider(10, range=1..100)))
unit_z_3 = UnitZ(Factor=expr("-x", Slider(20, range=0..100)))
load_case_liveload = Data(construct_2)
load_case_deadload = Data(construct)

surfaceload_uniform = SurfaceLoadUniform(Surface=top_flange, Force=unit_z_2, LoadCase=load_case_liveload)
surfaceload_uniform_2 = SurfaceLoadUniform(Surface=top_flange, Force=unit_z_3, LoadCase=load_case_deadload)

merge_17 = Merge(Data1=surfaceload_uniform, Data2=surfaceload_uniform_2)

# ----
# 7. Creating the model
# For this component to work properly, you have to keep
# a FEM-Design window open in the background.
countrycode_d_dk_est_fin_gb_h_n_pl_ro_s = Panel("")  # "Countrycode (D/DK/EST/FIN/GB/H/N/PL/RO/S/TR)"
bridge_surfaces = Data(flatten(slab_averagesurfaceelementsize))
supports = Data(flatten([pointsupport_define_2, pointsupport_define]))
pylons = Data(flatten(merge_16))
loads = Data(flatten(merge_17))
load_cases = Data(merge_7)
load_combinations = Data(merge_8)

model_construct = ModelConstruct(
    CountryCode=countrycode_d_dk_est_fin_gb_h_n_pl_ro_s,
    StructureElements=[supports, bridge_surfaces, pylons],
    Loads=loads,
    LoadCases=load_cases,
    LoadCombinations=load_combinations)

# ----
# 8. Open model and run analysis
# This section will open the model and run the analysis with the settings linked in the Analysis settings component.
# Open model
fem_design_connection = FEMDesignConnection(Verbosity="ScriptLogLinesOnly", DeleteOutputFolder=False)
fem_design_openmodel = FEMDesignOpenModel(Connection=fem_design_connection, Model=model_construct, RunNode=True)  # -> Connection, Model, Success

# ----
# Analysis settings
panel_13 = Panel("true")
analysis_define = AnalysisDefine(
    CalcCase=panel_13,
    CalcComb=panel_13,
    CalcCstage=False,
    CalcImpf=False,
    CalcGmax=False,
    CalcStab=False,
    CalcFreq=False,
    CalcSeis=False,
    CalcDesign=False,
    CalcFootfall=False,
    Elemfine=True,
    Diaphragm=0,
    PeakSmoothing=False)
fem_design_runanalysis = FEMDesignRunAnalysis(Connection=fem_design_openmodel.Connection, Analysis=analysis_define, RunNode=True)  # -> Connection, Log, Success
