# Grasshopper definition Practical example - Voronoi Structure.gh (Grasshopper 1.0.7)
# plug-ins: FEM-Design, Kangaroo2 Components, ghgl

rectangle = Rectangle(Plane=PlaneXY(0, 0, 0), XSize="5", YSize="12", Radius=0)  # -> Rectangle, Length
pop3d = Populate3D(Region=rectangle.Rectangle, Count=100, Seed=1)
voronoi = Voronoi(Points=pop3d, Boundary=rectangle.Rectangle, BruteForceOverride=False)
explode = Explode(Curve=voronoi, Recursive=True)  # -> Segments, Vertices
dupln = RemoveDuplicateLines(Lines=flatten(explode.Segments), Tolerance=0.01)
boundary = BoundarySurfaces(Edges=voronoi)
midpt = CurveMiddle(Curve=dupln)
default = MaterialDatabaseDefault(CountryCode="S")  # -> SteelMaterial, ConcreteMaterial, TimberMaterial, ReinforcementMaterial, StratumMaterial, CustomMaterial
default_2 = MaterialDatabaseDefault(CountryCode="S")  # -> SteelMaterial, ConcreteMaterial, TimberMaterial, ReinforcementMaterial, StratumMaterial, CustomMaterial
crv_cp = CurveClosestPoint(Point=midpt, Curve=rectangle.Rectangle)  # -> Point, Parameter, Distance
default_3 = SectionDatabaseDefault()  # -> SteelSection, ConcreteSection, TimberSection, HollowCoreSection, CustomSection
smaller = SmallerThan(FirstNumber=crv_cp.Distance, SecondNumber="0.01")  # -> SmallerThan, OrEqualTo
list = ValueList({"ordinary", "dead_load", "soil_dead_load", "shrinkage", "prestressing", "fire", "seis_sxp", "seis_sxm", "seis_syp", "seis_sym"}, selected="dead_load")
list_2 = ValueList({"ordinary", "dead_load", "soil_dead_load", "shrinkage", "prestressing", "fire", "seis_sxp", "seis_sxm", "seis_syp", "seis_sym"}, selected="ordinary")
list_3 = ValueList({"permanent", "long-term", "medium-term", "short-term", "instantaneous"}, selected="permanent")
list_4 = ValueList({"permanent", "long-term", "medium-term", "short-term", "instantaneous"}, selected="permanent")
dispatch = Dispatch(List=dupln, DispatchPattern=invert(smaller.SmallerThan))  # -> ListA, ListB
item = ListItem(List=default.SteelMaterial, Index=0, Wrap=True)
item_2 = ListItem(List=default_2.ConcreteMaterial, Index=0, Wrap=True)
item_3 = ListItem(List=default_3.SteelSection, Index=0, Wrap=True)
construct = LoadCaseConstruct(Name="LiveLoad", Type=list_2, DurationClass=list_4)
construct_2 = LoadCaseConstruct(Name="DeadLoad", Type=list, DurationClass=list_3)
material = Data(item)
section = Data(item_3)
crv = Curve(dispatch.ListB)
# Dummy Geometry
crv_2 = Curve(dispatch.ListA)
srf = Surface(boundary)
merge = Merge(Data1=construct_2, Data2=construct)
hinged = LineSupportHinged(Curve=crv, MovingLocal=False, OrientLCS=True, Identifier="S")
construct_3 = Plate(Surface=srf, Thickness="0.15", Material=item_2, Identifier="P")
beam = BarsBeam(Curve=crv_2, Material=material, Section=section, OrientLCS=True, Identifier="B")
list_5 = ValueList({"ultimate_ordinary", "ultimate_accidental", "ultimate_seismic", "serviceability_quasi_permanent", "serviceability_frequent", "serviceability_characteristic"}, selected="ultimate_ordinary")
panel = Panel("""1.35
1.5""")
load_case = Data(merge)
Z = UnitZ(Factor="-1.00")
Z_2 = UnitZ(Factor="-2.00")
uniform = SurfaceLoadUniform(Surface=srf, Force=Z_2, LoadCase=construct)
force = LineLoadForce(Curve=crv_2, StartForce=Z, LoadCase=construct, ConstLoadDir=True, LoadProjection=False)
construct_4 = LoadCombinationConstruct(Name="ULS", Type=list_5, LoadCase=load_case, Gamma=panel)
loadcombinations = Data(flatten(construct_4))
loadcases = Data(flatten(merge))
elements = Data(flatten([beam, hinged, construct_3]))
loads = Data(flatten([force, uniform]))
construct_5 = ModelConstruct(CountryCode="S", StructureElements=elements, Loads=loads, LoadCases=loadcases, LoadCombinations=loadcombinations)
toggle = BooleanToggle(True)
resultstype = ResultsType({"NodalDisplacement", "PointSupportReaction", "PointSupportReactionMinMax", "BarDisplacement", "BarInternalForce", "BarStress", "LineSupportReaction", "LineConnectionResultant", "LineConnectionForce", "SurfaceSupportReaction", "ShellDisplacement", "ShellInternalForce", "ShellStress", "LabelledSectionInternalForce", "LabelledSectionResultant", "NodalVibrationShape", "EigenFrequencies", "QuantityEstimationConcrete", "QuantityEstimationSteel", "QuantityEstimationTimber", "QuantityEstimationTimberPanel", "QuantityEstimationGeneral", "QuantityEstimationReinforcement"}, selected="NodalDisplacement")
define = AnalysisDefine(
    CalcCase=toggle,
    CalcCstage=False,
    CalcImpf=False,
    CalcComb=toggle,
    CalcGmax=False,
    CalcStab=False,
    CalcFreq=False,
    CalcSeis=False,
    CalcDesign=False,
    CalcFootfall=False,
    Elemfine=False,
    Diaphragm=False,
    PeakSmoothing=False)
runanalysis = ApplicationRunAnalysis(
    Model=construct_5,
    Analysis=define,
    ResultTypes=resultstype,
    EndSession=True,
    CloseOpenWindows=True,
    RunNode=Toggle(True))  # -> Model, FiniteElement, Results, HasExited
femshell = FiniteElementFemShell(FiniteElement=runanalysis.FiniteElement)  # -> Identifier, ElementId, FaceIndex, MeshGeometry
nodaldisplacement = NodalDisplacement(Result=runanalysis.Results, CaseCombinationName="LiveLoad")  # -> CaseIdentifier, NodeId, Translation, Rotation
femnode = FiniteElementFemNode(FiniteElement=runanalysis.FiniteElement)  # -> NodeId, Point
vector_length = VectorLength(Vector=nodaldisplacement.Translation)
bounds = Bounds(Numbers=vector_length)
deconstruct_mesh = DeconstructMesh(Mesh=femshell.MeshGeometry)  # -> Vertices, Faces, Colours, Normals
python = GhPythonScript(NodeId=femnode.NodeId, Point=femnode.Point, Node=nodaldisplacement.NodeId)  # -> out, a; inputs NodeId: list, Point: list of Point3d, Node: list of Int32
# ---------- python: Python ----------
my_dict = {}

for id, point in zip(NodeId,Point):
    my_dict[id] = point

a = []
for value in Node:
    a.append( my_dict[value] )
# ---------- end python ----------
deconstruct_domain = DeconstructDomain(Domain=bounds)  # -> Start, End
gradient = Gradient(
    LowerLimit=deconstruct_domain.Start,
    UpperLimit=deconstruct_domain.End,
    Parameter=vector_length,
    stops=[0: RGB(243, 57, 0), 0.1: RGB(236, 27, 60), 0.115: RGB(210, 0, 118), 0.3: RGB(103, 0, 120), 0.4: RGB(39, 72, 161), 0.5: RGB(1, 192, 229), 0.6: RGB(18, 178, 90), 0.7: RGB(79, 186, 8), 0.8: RGB(220, 237, 32), 0.9: RGB(247, 159, 20), 1: RGB(243, 57, 0)])
python_2 = GhPythonScript(NodeId=python.a, Point=vector_length, Node=deconstruct_mesh.Vertices)  # -> out, a; inputs NodeId: list of Point3d, Point: list, Node: list of Point3d; same code as python
gl_mesh_shader = GLMeshShader(
    DrawMode=4,
    FragmentShader="""#version 330

uniform vec3 _lightDirection[4];
uniform mat3 _worldToCameraNormal;

in  vec3 normal;
out vec4 FragColor;

void main()
{
  vec3 l = normalize(_lightDirection[0]);
  vec3 camNormal = _worldToCameraNormal * normal;
  float intensity = dot(l,normalize(camNormal.xyz));
  vec4 diffuse = vec4(1,0,1,1);

  vec3 ambient = vec3(0.1,0.1,0.1) * diffuse.rgb;
  vec3 c = ambient + diffuse.rgb * abs(intensity);
  FragColor = vec4(c, diffuse.a);
}""",
    GLShader=(0, 1, 0),
    VertexShader="""#version 330

layout(location = 0) in vec3 _meshVertex;
layout(location = 1) in vec3 _meshNormal;

uniform mat4 _worldToClip;
out vec3 normal;

void main() 
{
  normal = _meshNormal;
  gl_Position = _worldToClip * vec4(_meshVertex,1);
}""",
    glLineWidth=3,
    glPointSize=8)
gl_shader = GLShader(
    Vertex=python.a,
    Vcolor=gradient,
    DrawMode=0,
    FragmentShader="""#version 330

in vec4 vertex_color;

void main()
{
  gl_FragColor = vertex_color;
}""",
    GLShader=(0, 1, 0),
    VertexShader="""#version 330

layout(location = 0) in vec3 vertex;
layout(location = 1) in vec4 vcolor;
uniform mat4 _worldToClip;
out vec4 vertex_color;

void main() 
{
  vertex_color = vcolor;
  gl_Position = _worldToClip * vec4(vertex,1);
}""",
    glLineWidth=3,
    glPointSize=8)
