# Grasshopper definition ConstructModel.gh (Grasshopper 1.0.7)
# plug-ins: FEM-Design, Tenrec

# ---- group: ModelConstruct
pt = Point(Point(0, 0, 0))
default = MaterialDatabaseDefault(CountryCode="S")  # -> SteelMaterial, ConcreteMaterial, TimberMaterial, ReinforcementMaterial, StratumMaterial, CustomMaterial
default_2 = SectionDatabaseDefault()  # -> SteelSection, ConcreteSection, TimberSection, HollowCoreSection, CustomSection
X = UnitX(Factor=1)
item = ListItem(List=default.SteelMaterial, Index=0, Wrap=True)
item_2 = ListItem(List=default_2.SteelSection, Index=0, Wrap=True)
line = LineSDL(Start=pt, Direction=X, Length="6.0")
list = ValueList({"ordinary", "dead_load", "soil_dead_load", "shrinkage", "prestressing", "fire", "seis_sxp", "seis_sxm", "seis_syp", "seis_sym"}, selected="dead_load")
rigid = PointSupportRigid(PointPlane=pt, Identifier="S")
construct = LoadCaseConstruct(Name="DL", Type=list, DurationClass="permanent")
beam = BarsBeam(Curve=line, Material=item, Section=item_2, OrientLCS=True, Identifier="B")
construct_2 = ModelConstruct(CountryCode="S", StructureElements=flatten([rigid, beam]), LoadCases=construct)
deconstruct = ModelDeconstruct(Model=construct_2)  # -> CountryCode, Foundations, Bars, FictitiousBars, Shells, FictitiousShells, Diaphragms, LabelledSection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
lng = ListLength(List=deconstruct.Bars)
null = NullItem(Item=deconstruct.Bars)  # -> NullFlags, InvalidFlags, Description
equals = Equality(FirstNumber=lng, SecondNumber="1")  # -> Equality, Inequality
bool = Boolean(invert(null.NullFlags))
assert = Assert(Assert=equals.Equality, Message="List length != 1")
assert_2 = Assert(Assert=bool, Message="Calculation Error!")
