# Grasshopper definition Example - bridge.gh (Grasshopper 1.0.7)
# plug-ins: FemDesign.Grasshopper

# ----
# Variables
width_extra_edge = Slider(6, range=1..50)
width_driving_lane = Slider(10, range=1..50)
width_base = Slider(7, range=1..50)
height = Slider(4, range=1..50)
axis_crossection_base_point = Point(Point(0, 0, 0))

# ----
# Method 3: Doubly curved axis (Start/end points, start/end tangents,
# and straight distance between ends)
start_tangent_x = Slider(-8, range=-20..20)
start_tangent_y = Slider(4, range=-20..20)
bridge_length = Slider(115, range=1..500)
start_tangent_z = Slider(5, range=-20..20)
end_tangent_x = Slider(-12, range=-20..20)
end_tangent_y = Slider(13, range=-20..20)
end_tangent_z = Slider(-13, range=-20..20)
vector_xyz = VectorXYZ(XComponent=start_tangent_x, YComponent=start_tangent_y, ZComponent=start_tangent_z)  # -> Vector, Length
vector_xyz_2 = VectorXYZ(XComponent=end_tangent_x, YComponent=end_tangent_y, ZComponent=end_tangent_z)  # -> Vector, Length
axis_crossection_base_point_2 = Point(axis_crossection_base_point)
unit_y = UnitY(Factor=bridge_length)
move = Move(Geometry=axis_crossection_base_point_2, Motion=unit_y)  # -> Geometry, Transform
biarc = BiArc(
    StartPoint=axis_crossection_base_point_2,
    StartTangent=vector_xyz.Vector,
    EndPoint=move.Geometry,
    EndTangent=vector_xyz_2.Vector,
    Ratio=0.5)  # -> FirstArc, SecondArc, BiArc
curve_middle = CurveMiddle(Curve=biarc.FirstArc)
deconstruct = Deconstruct(Point=curve_middle)  # -> XComponent, YComponent, ZComponent
get_data_from_me = Curve(biarc.BiArc)
rise_m = Panel(deconstruct.ZComponent)

# ----
# Method 1: straight line axis (start and end)
bridge_length_2 = Slider(42, range=1..500)
axis_crossection_base_point_3 = Point(axis_crossection_base_point)
unit_y_2 = UnitY(Factor=bridge_length_2)
# Creating the axis of the bridge
move_2 = Move(Geometry=axis_crossection_base_point_3, Motion=unit_y_2)  # -> Geometry, Transform
line = Line(StartPoint=axis_crossection_base_point_3, EndPoint=move_2.Geometry)

# ----
# Method 2: arch axis (start, end and midpoint height)
number_slider = Slider(10, range=0..20)
bridge_length_3 = Slider(60, range=1..500)
axis_crossection_base_point_4 = Point(axis_crossection_base_point)
unit_y_3 = UnitY(Factor=bridge_length_3)
vector_xyz_3 = VectorXYZ(XComponent=0, YComponent=expr("x/2", bridge_length_3), ZComponent=number_slider)  # -> Vector, Length
move_3 = Move(Geometry=axis_crossection_base_point_4, Motion=vector_xyz_3.Vector)  # -> Geometry, Transform
move_4 = Move(Geometry=axis_crossection_base_point_4, Motion=unit_y_3)  # -> Geometry, Transform
merge = Merge(Data1=axis_crossection_base_point_4, Data2=move_3.Geometry, Data3=move_4.Geometry)
nurbs_curve = NurbsCurve(Vertices=merge, Degree="2", Periodic=False)  # -> Curve, Length, Domain

# ----
# Geometry
unit_z = UnitZ(Factor=expr("-x", height))
unit_x = UnitX(Factor=width_driving_lane)
move_5 = Move(Geometry=axis_crossection_base_point, Motion=unit_x)  # -> Geometry, Transform
# Creating the crossection
unit_x_2 = UnitX(Factor=width_extra_edge)
move_6 = Move(Geometry=axis_crossection_base_point, Motion=unit_z)  # -> Geometry, Transform
unit_x_3 = UnitX(Factor=width_base)
move_7 = Move(Geometry=move_5.Geometry, Motion=unit_x_2)  # -> Geometry, Transform
move_8 = Move(Geometry=move_6.Geometry, Motion=unit_x_3)  # -> Geometry, Transform
line_2 = Line(StartPoint=move_7.Geometry, EndPoint=move_5.Geometry)
line_3 = Line(StartPoint=move_5.Geometry, EndPoint=axis_crossection_base_point)
line_4 = Line(StartPoint=move_5.Geometry, EndPoint=move_8.Geometry)
line_5 = Line(StartPoint=move_6.Geometry, EndPoint=move_8.Geometry)
merge_2 = Merge(Data1=line_2, Data2=line_3, Data3=line_4, Data4=line_5)
mirror = Mirror(Geometry=merge_2, Plane=PlaneYZ(0, 0, 0))  # -> Geometry, Transform
flip_curve = FlipCurve(Curve=mirror.Geometry)  # -> Curve, Flag
merge_3 = Merge(Data1=merge_2, Data2=flip_curve.Curve)

# ----
# Select your method by
# connecting to this container
bridge_axis_select_your_axis_method = Curve(get_data_from_me)

# ---- group: Warning: lower values means heavier calculations!
triangulation_length_avg = Slider(3.24, range=0.5..10)

# ---- group: WARNING: Higher values means heavier calculation
curve_divisions = Slider(20, range=0..20)

# ----
# OLD: Creating the raw shape of the bridge
crossection = Curve(graft(merge_3))
bridge_axis = Curve(bridge_axis_select_your_axis_method)
axis_crossection_base_point_5 = Point(axis_crossection_base_point)
divide_curve = DivideCurve(Curve=bridge_axis, Count=curve_divisions, Kinks=False)  # -> Points, Tangents, Parameters
deconstruct_vector = DeconstructVector(Vector=divide_curve.Tangents)  # -> XComponent, YComponent, ZComponent
vector_display = VectorDisplay(Anchor=divide_curve.Points, Vector=divide_curve.Tangents)
vector_xyz_4 = VectorXYZ(XComponent=deconstruct_vector.XComponent, YComponent=deconstruct_vector.YComponent, ZComponent=0)  # -> unitize(Vector), Length
unit_y_4 = UnitY(Factor=1)
orient_direction = OrientDirection(
    Geometry=crossection,
    PointA=axis_crossection_base_point_5,
    DirectionA=unit_y_4,
    PointB=divide_curve.Points,
    DirectionB=vector_xyz_4.Vector)  # -> Geometry, Transform
loft = Loft(
    Curves=orient_direction.Geometry,
    Options={Adjust=False, Closed=False, LoftEnds=0, LoftSimp=0, LoftType=3, Rebuild=10, Refit=0.01})

# ----
# Method 2: Explicit length from bridge start
panel = Panel("""0
10
20""")
bridge_axis_2 = Curve(reparameterize(bridge_axis_select_your_axis_method))
length = Length(Curve=bridge_axis_2)
remap_numbers = RemapNumbers(Value=panel, Source=length, Target=Domain(0, 1))  # -> Mapped, Clipped
evaluate_curve = EvaluateCurve(Curve=reparameterize(bridge_axis_2), Parameter=remap_numbers.Mapped)  # -> Point, Tangent, Angle

# ----
# Method 1: relative length along bridge axis
panel_2 = Panel("""0
0.2
0.6
1""")
bridge_axis_3 = Curve(bridge_axis_select_your_axis_method)
evaluate_curve_2 = EvaluateCurve(Curve=reparameterize(bridge_axis_3), Parameter=panel_2)  # -> Point, Tangent, Angle

# ----
# Defining load cases
panel_3 = Panel("Liveload")
loadcase_create = LoadCaseCreate(Name=panel_3, Type="static", DurationClass="permanent")
loadcase_create_2 = LoadCaseCreate(Name="Deadload", Type="dead_load", DurationClass="permanent")
merge_4 = Merge(Data1=loadcase_create, Data2=loadcase_create_2)

# ----
# Select your method by
# connecting to this container
points_on_curve_pick_your_point_method = Point(evaluate_curve_2.Point)

# ----
# OLD: Building mesh and rebuilding to triangle surfaces
panel_4 = Panel("2.0")
settings_custom = SettingsCustom(
    StitchSeams=True,
    SimplePlanes=False,
    Refine=True,
    MinCount=16,
    MaxCount=400,
    AspectRatio=panel_4,
    MaxDistance=0,
    MaxAngle="20.0",
    MinEdge="1.5",
    MaxEdge="3.0")
mesh_brep = MeshBrep(Brep=loft, Settings=settings_custom)  # disabled
deconstruct_mesh = DeconstructMesh(Mesh=mesh_brep)  # -> Vertices, Faces, Colours, Normals
deconstruct_face = DeconstructFace(Face=deconstruct_mesh.Faces)  # -> CornerA, CornerB, CornerC, CornerD
list_item = ListItem(List=deconstruct_mesh.Vertices, Index=deconstruct_face.CornerA, Wrap=True)
list_item_2 = ListItem(List=deconstruct_mesh.Vertices, Index=deconstruct_face.CornerB, Wrap=True)
list_item_3 = ListItem(List=deconstruct_mesh.Vertices, Index=deconstruct_face.CornerC, Wrap=True)
list_item_4 = ListItem(List=deconstruct_mesh.Vertices, Index=deconstruct_face.CornerD, Wrap=True)
_4point_surface = _4PointSurface(CornerA=list_item, CornerB=list_item_3, CornerC=list_item_4)
_4point_surface_2 = _4PointSurface(CornerA=list_item, CornerB=list_item_2, CornerC=list_item_3)
merge_5 = Merge(Data1=_4point_surface_2, Data2=_4point_surface)

# ----
# Support reference points
panel_5 = Panel("""{2}
{6}""")
tree_branch = TreeBranch(Tree=simplify(mesh_brep), Path=panel_5, MaintainPaths=True)
move_9 = Move(Geometry=points_on_curve_pick_your_point_method, Motion=unit_z)  # -> Geometry, Transform
deconstruct_mesh_2 = DeconstructMesh(Mesh=tree_branch)  # -> Vertices, Faces, Colours, Normals
closest_point = ClosestPoint(Point=move_9.Geometry, Cloud=deconstruct_mesh_2.Vertices)  # -> ClosestPoint, CPIndex, Distance

# ----
# Defining loads
all_surfaces = Surface(simplify(merge_5))
panel_6 = Panel("""{0}
{1}
{4}
{5}""")
tree_branch_2 = TreeBranch(Tree=all_surfaces, Path=panel_6, MaintainPaths=True)
flange = Surface(tree_branch_2)
unit_z_2 = UnitZ(Factor=expr("-x", Slider(10, range=1..100)))
unit_z_3 = UnitZ(Factor=expr("-x", Slider(20, range=0..100)))
load_case_liveload = Data(loadcase_create)
load_case_deadload = Data(loadcase_create_2)
surfaceload_uniform = SurfaceLoadUniform(Surface=flange, Force=unit_z_2, LoadCase=load_case_liveload)
surfaceload_uniform_2 = SurfaceLoadUniform(Surface=flange, Force=unit_z_3, LoadCase=load_case_deadload)
merge_6 = Merge(Data1=surfaceload_uniform, Data2=surfaceload_uniform_2)

# ----
# Defining load combinations
panel_7 = Panel("serviceability_characteristic")
panel_8 = Panel("""1.35
1.5""")
panel_9 = Panel("""1.0
1.0""")
loadcombination_create = LoadCombinationCreate(Name="SLS", Type=panel_7, LoadCase=merge_4, Gamma=panel_9)
loadcombination_create_2 = LoadCombinationCreate(Name="ULS", Type="ultimate_ordinary", LoadCase=merge_4, Gamma=panel_8)
merge_7 = Merge(Data1=loadcombination_create, Data2=loadcombination_create_2)

# ----
# Constructing element
panel_10 = Panel("S")
materialdatabase_default = MaterialDatabaseDefault(CountryCode=panel_10)
material_getmaterialbyname = MaterialGetMaterialByName(MaterialDatabase=materialdatabase_default, MaterialName="C25/30")
fem_design_mesh_size = Slider(0.8, range=0..1)
slab_plate = SlabPlate(Surface=merge_5, Thickness=Slider(0.5, range=0.1..1), Material=material_getmaterialbyname, Identifier="P")
slab_averagesurfaceelementsize = SlabAverageSurfaceElementSize(Slab=slab_plate, AverageSurfaceElementSize=fem_design_mesh_size)

is_planar = IsPlanar(Surface=merge_5, Interior=True)  # -> flatten(Planar), Plane
mass_multiplication = MassMultiplication(Input=is_planar.Planar)  # -> Result, PartialResults
error_check_are_the_surfaces_planar_1_tr = Panel(mass_multiplication.Result)  # "Error check: Are the surfaces planar? (1 = true)"

# ----
# Analysis settings
panel_11 = Panel("true")
# Open model and run analysis
analysis_define = AnalysisDefine(
    CalcCase=panel_11,
    CalcCstage=False,
    CalcImpf=False,
    CalcComb=panel_11,
    CalcGmax=False,
    CalcStab=False,
    CalcFreq=False,
    CalcSeis=False,
    CalcDesign=False,
    CalcFootfall=False,
    Elemfine=False,
    Diaphragm=False,
    PeakSmoothing=False)

# ----
# NEW: Creating the bridge volume and triangulating it
# TO DO: Connect the correct points to create triangular surfaces. Be wary of data structure and wrapped lists - I accidently crashed Grasshopper twice connecting these components! /Samuel
crossection_2 = Curve(graft(merge_3))
bridge_axis_4 = Curve(bridge_axis_select_your_axis_method)
axis_crossection_base_point_6 = Point(axis_crossection_base_point)
length_2 = Length(Curve=bridge_axis_4)
division = Division(A=length_2, B=triangulation_length_avg)
round = Round(Number=division)  # -> Nearest, Floor, Ceiling
number_of_segments_lenghwise = Panel(round.Floor)
length_3 = Length(Curve=crossection_2)
divide_curve_2 = DivideCurve(Curve=bridge_axis_4, Count=round.Floor, Kinks=False)  # -> Points, Tangents, Parameters
division_2 = Division(A=length_3, B=triangulation_length_avg)
deconstruct_vector_2 = DeconstructVector(Vector=divide_curve_2.Tangents)  # -> XComponent, YComponent, ZComponent
vector_display_2 = VectorDisplay(Anchor=divide_curve_2.Points, Vector=divide_curve_2.Tangents)
vector_xyz_5 = VectorXYZ(XComponent=deconstruct_vector_2.XComponent, YComponent=deconstruct_vector_2.YComponent, ZComponent=0)  # -> unitize(Vector), Length
unit_y_5 = UnitY(Factor=1)
orient_direction_2 = OrientDirection(
    Geometry=crossection_2,
    PointA=axis_crossection_base_point_6,
    DirectionA=unit_y_5,
    PointB=divide_curve_2.Points,
    DirectionB=vector_xyz_5.Vector)  # -> Geometry, Transform
_4point_surface_3 = _4PointSurface()
_4point_surface_4 = _4PointSurface()
merge_8 = Merge(Data1=_4point_surface_4, Data2=_4point_surface_3)

round_2 = Round(Number=division_2)  # -> Nearest, Floor, Ceiling
number_of_segments_across = Panel(round_2.Floor)

divide_curve_3 = DivideCurve(Curve=orient_direction_2.Geometry, Count=round_2.Floor, Kinks=False)  # -> simplify(Points), Tangents, Parameters
param_viewer = ParamViewer(divide_curve_3.Points)
relative_item = RelativeItem(Tree=divide_curve_3.Points, Offset="{0;+1}", WrapPaths=False, WrapItems=False)  # -> ItemA, ItemB
relative_item_2 = RelativeItem(Tree=divide_curve_3.Points, Offset="{0;+1}(+1)", WrapPaths=False, WrapItems=False)  # -> ItemA, ItemB
shift_list = ShiftList(List=divide_curve_3.Points, Shift=1, Wrap=True)  # -> simplify(List)

# ----
# For visualisation only -
# no output from here!
loft_2 = Loft(
    Curves=orient_direction_2.Geometry,
    Options={Adjust=False, Closed=False, LoftEnds=0, LoftSimp=0, LoftType=3, Rebuild=10, Refit=0.01})

# ----
# For visualisation only -
# no output from here!
line_6 = Line(StartPoint=shift_list, EndPoint=divide_curve_3.Points)
line_7 = Line(StartPoint=relative_item.ItemA, EndPoint=relative_item.ItemB)
line_8 = Line(StartPoint=relative_item_2.ItemA, EndPoint=relative_item_2.ItemB)

# ----
# Creating supports
all_support_points = Point(closest_point.ClosestPoint)

# ----
# Support conditions
panel_12 = Panel("10^7")
panel_13 = Panel("0")
rotations_define = RotationsDefine(X_neg="0", X_pos="0", Y_neg="0", Y_pos="0", Z_neg="0", Z_pos="0")
motions_define = MotionsDefine(X_neg="10^7", X_pos="10^7", Y_neg="10^7", Y_pos="10^7", Z_neg="10^7", Z_pos="10^7")
pointsupport_define = PointSupportDefine(Point=all_support_points, Motions=motions_define, Rotations=rotations_define, Identifier="S")

merge_9 = Merge(Data1=pointsupport_define)

# ----
# Create final model
countrycode_d_dk_est_fin_gb_h_n_pl_ro_s = Panel("S")  # "Countrycode (D/DK/EST/FIN/GB/H/N/PL/RO/S/TR)"
supports = Data(flatten(merge_9))
bridge_surfaces = Data(flatten(slab_averagesurfaceelementsize))
loads = Data(flatten(merge_6))
load_cases = Data(merge_4)
load_combinations = Data(merge_7)
model_createsimple = ModelCreateSimple(
    CountryCode=countrycode_d_dk_est_fin_gb_h_n_pl_ro_s,
    StructureElements=[supports, bridge_surfaces],
    Loads=loads,
    LoadCases=load_cases,
    LoadCombinations=load_combinations)

file_name_end_with_struxml = Panel("bridge_analysis.struxml")
press_to_open_model_in_fem_design_and_ru = Button()  # "Press to open model in FEM-Design and run analysis:"
close_all_open_fem_design_windows_when_r = BooleanToggle(True)  # "Close all open FEM-Design windows when running?"
close_fem_design_window_after_analysis_i = BooleanToggle(False)  # "Close FEM-Design window after analysis is done?"
directory = FilePath("C:\Users\SamuelNyberg\OneDrive - StruSoft AB\Samuels arbetshörna\3. Practical examples\3.1. Bridge\")
concatenate = Concatenate(FragmentA=directory, FragmentB=file_name_end_with_struxml)
resulting_file_path = Panel(concatenate)
analysis_settings = Data(analysis_define)
model = Data(model_createsimple)
application_runanalysis = ApplicationRunAnalysis(
    FdModel=model,
    FilePathStruxml=concatenate,
    Analysis=analysis_settings,
    EndSession=close_fem_design_window_after_analysis_i,
    CloseOpenWindows=close_all_open_fem_design_windows_when_r,
    RunNode=press_to_open_model_in_fem_design_and_ru)

# ----
# Open model in FEM-Design
press_to_open_model_in_fem_design_and_ru_2 = Button()  # "Press to open model in FEM-Design and run analysis:"
close_all_open_fem_design_windows_when_r_2 = BooleanToggle(True)  # "Close all open FEM-Design windows when running?"
model_open = ModelOpen(
    FdModel=model_createsimple,
    FilePathStruxml=concatenate,
    CloseOpenWindows=close_all_open_fem_design_windows_when_r_2,
    RunNode=press_to_open_model_in_fem_design_and_ru_2)
