# Dynamo graph PointSupport.dyn (Dynamo 2.10.0.3455)
# packages: FemDesign 2 1.0.0, FemDesign ZeroTouch 1.0.0

byCoordinates = Point.ByCoordinates()
code_block = CodeBlock { "Alex"; }
pointSupport = PointSupportNodeModel(inputPoint=byCoordinates, inputString=code_block)
hinged = FemDesign.DynamoZeroTouch.PointSupport.Hinged(point=byCoordinates, identifier=code_block)
